# Grasshopper definition Glass_SimpleModel.gh (Grasshopper 0.9.64)

number_slider = Slider(0, range=0..20)
number_slider_2 = Slider(12, range=3..12)
pt = Point(<point referenced from the Rhino model>)
circle = CircleCNR(Center=pt, Normal=Vector(0, 0, 1), Radius=Slider(20, range=20..40))
Z = UnitZ(Factor=1)
number_slider_3 = Slider(33, range=20..50)
multiplication = Multiplication(A=Slider(10, range=10..50), B=Z)
move = Move(Geometry=circle, Motion=multiplication)  # -> Geometry, Transform
circle_2 = CircleCNR(Center=pt, Normal=Vector(0, 0, 1), Radius=Slider(34, range=20..40))
circle_3 = CircleCNR(Center=pt, Normal=Vector(0, 0, 1), Radius=Slider(29, range=20..40))
circle_4 = CircleCNR(Center=pt, Normal=Vector(0, 0, 1), Radius=Slider(23, range=20..40))
toggle = BooleanToggle(True)
num = Number(2)
Z_2 = UnitZ(Factor=1)
divide = DivideCurve(Curve=circle_2, Count=number_slider_2, Kinks=False)  # -> Points, Tangents, Parameters
Z_3 = UnitZ(Factor=1)
divide_2 = DivideCurve(Curve=circle_3, Count=number_slider_2, Kinks=False)  # -> Points, Tangents, Parameters
Z_4 = UnitZ(Factor=1)
multiplication_2 = Multiplication(A=number_slider_3, B=Z_2)
divide_3 = DivideCurve(Curve=circle_4, Count=number_slider_2, Kinks=False)  # -> Points, Tangents, Parameters
division = Division(A=multiplication_2, B=num)
multiplication_3 = Multiplication(A=number_slider_3, B=Z_4)
extr = Extrude(Base=move.Geometry, Direction=multiplication_3)
pline = PolyLine(Vertices=divide.Points, Closed=toggle)
pline_2 = PolyLine(Vertices=divide_3.Points, Closed=toggle)
move_2 = Move(Geometry=pline_2, Motion=multiplication_2)  # -> Geometry, Transform
rad = Radians(Degrees=Slider(145, range=0..360))
division_2 = Division(A=rad, B=num)
move_3 = Move(Geometry=pline, Motion=division)  # -> Geometry, Transform
rotate = Rotate(Geometry=move_3.Geometry, Angle=division_2, Plane=PlaneXY(0, 0, 0))  # -> Geometry, Transform
pline_3 = PolyLine(Vertices=divide_2.Points, Closed=toggle)
rotate_2 = Rotate(Geometry=move_2.Geometry, Angle=rad, Plane=PlaneXY(0, 0, 0))  # -> Geometry, Transform
fillet = Fillet(Curve=pline_3, Radius=number_slider)
fillet_2 = Fillet(Curve=rotate.Geometry, Radius=number_slider)
fillet_3 = Fillet(Curve=rotate_2.Geometry, Radius=number_slider)
merge = Merge(Data1=fillet, Data2=fillet_2, Data3=fillet_3)
loft = Loft(Curves=merge, Options={Adjust=False, Closed=False, LoftEnds=0, LoftSimp=0, LoftType=0, Rebuild=10, Refit=0.01})
cap = CapHoles(Brep=extr)
cap_2 = CapHoles(Brep=loft)
sdiff = SolidDifference(BrepsA=cap_2, BrepsB=cap)
